# Grasshopper definition rhino_input.gh (Grasshopper 1.0.7)

number_slider = Slider(1, range=0..10)
encodedfile = GetString(AtLeast=1, AtMost=1, TreeAccess=False)

# ---- group: just to test
path = FilePath("C:\Users\david\IAAC\MaCAD\datamgmt\repos\bimsc24-datamgmt-session06\src\assets\rhino_input.3dm")

# ----
Y = GetNumber(number_slider, AtLeast=1, AtMost=1, Maximum=1.797693135e+308, Minimum=-1.797693135e+308, TreeAccess=False)
Z = GetNumber(number_slider, AtLeast=1, AtMost=1, Maximum=1.797693135e+308, Minimum=-1.797693135e+308, TreeAccess=False)
X = GetNumber(number_slider, AtLeast=1, AtMost=1, Maximum=1.797693135e+308, Minimum=-1.797693135e+308, TreeAccess=False)
# no points allowed in 3dm!
python = GhPythonScript(data=encodedfile, FP=path)  # -> out, geom, layerIndex, layers, layerColor, instances, instLayInd
# ---------- python: Python ----------
import System
import Rhino

try:
    b64 = System.Convert.FromBase64String(data)
    _dmfile = Rhino.FileIO.File3dm.FromByteArray(b64)
except:
    _dmfile = Rhino.FileIO.File3dm.Read(FP)
    print _dmfile

objtable = _dmfile.Objects

geom = []
geomLayerIndexList = []
for obj in objtable:
    
    if not isinstance(obj.Geometry,Rhino.Geometry.InstanceReferenceGeometry):
        for k in obj.Attributes.GetUserStrings().AllKeys:
            value =  obj.Attributes.GetUserString(k)
            obj.Geometry.SetUserString(k, value)
        geom.append(obj.Geometry)
        geomLayerIndexList.append(obj.Attributes.LayerIndex)
        

geom_= geom
layerIndex_ = geomLayerIndexList

layers = []
layerColor = []
for l in _dmfile.Layers:
    layerColor.append(l.Color)
    layers.append(l)
    
    
layers_ = layers
layerColor_  = layerColor
# ---------- end python ----------
panel = Panel(python.geom)
panel_2 = Panel(python.layers)
list = ValueList({"Mesh": 0, "Brep": 1, "SubD": 2, "Curve": 3}, selected="SubD")
type = GetString(list, AtLeast=1, AtMost=1, TreeAccess=False)
panel_3 = Panel(python.layerIndex)
panel_4 = Panel(python.layerColor)

# ---- group: filter by type
python_2 = GhPythonScript(type=type, geo=python.geom)  # -> out, filter_geo, unfiltered; inputs type: Int32, geo: list of GeometryBase
# ---------- python_2: Python ----------
import Rhino.Geometry as rg
import rhinoscriptsyntax as rs

filter_geo= []
unfiltered = []
geo_types = ["Mesh", "Brep", "SubD", "NurbsCurve" ]

for g in geo:
    
    g = rs.coercegeometry(g)
    
    if type(g).__name__ == geo_types[_type]:

        filter_geo.append(g)
    else:
        unfiltered.append(g)
        
filter_geo_ = filter_geo
unfiltered_ = unfiltered
# ---------- end python_2 ----------

# ----
number_slider_2 = Slider(1, range=0..3)
item = ListItem(List=python.geom, Index=number_slider_2, Wrap=True)
volume = Volume(Geometry=python_2.filter_geo)  # -> Volume, Centroid
item_2 = ListItem(List=python.layerIndex, Index=number_slider_2, Wrap=True)
item_3 = ListItem(List=python.layers, Index=item_2, Wrap=True)
item_4 = ListItem(List=python.layerColor, Index=item_2, Wrap=True)
scale_nu = ScaleNU(Geometry=python_2.filter_geo, Plane=volume.Centroid, ScaleX=X, ScaleY=Y, ScaleZ=Z)  # -> Geometry, Transform
preview = CustomPreview(Geometry=item, Material=item_4)
merge = Merge(Data1=scale_nu.Geometry, Data2=python_2.unfiltered)
item_5 = ListItem(List=python.layerColor, Index=python.layerIndex, Wrap=True)

# ---- group: convert breps to meshes
python_3 = GhPythonScript(geo=merge)  # -> out, converted; inputs geo: list of GeometryBase
# ---------- python_3: Python ----------
import Rhino.Geometry as rg

def convertBrepToMesh(brep):

    mp = rg.MeshingParameters.Coarse
    g = rg.Mesh.CreateFromBrep(brep, mp)
    newm = rg.Mesh()
    for meshes in g:
        newm.Append(meshes)
    return newm
    
converted = []

for g in geo:
    if type(g).__name__ == "Brep":
        try:
            mesh =convertBrepToMesh(g)
            
            converted.append(mesh)
        except:
            continue
    else:
        converted.append(g)

converted_ = converted
# ---------- end python_3 ----------

# ---- group: must be a string
uservalue = Text(item_5)
userkey = Text("color")

# ----
c_script = CSharpScript(geometry=python_3.converted, userKey=userkey, userValue=uservalue)  # -> out, geoWithUserString; inputs geometry: GeometryBase, userKey: String, userValue: String
# ---------- c_script: C# ----------
    geometry.SetUserString(userKey, userValue);
   geoWithUserString = geometry;
# ---------- end c_script ----------
context_bake = ContextBake(ScaledGeo=c_script.geoWithUserString)
